% Simulink data dictionary dictionary_srf_pll.sldd

BusObject = Simulink.Bus(HeaderFile="fault")
A0 = fi(-0.7433629, 1, 32, 30)
A1 = fi(-0.2406804, 1, 32, 31)
A3 = fi(2, 1, 32, 29)
A4 = fi(1.015957, 1, 32, 30)
B0 = fi(256, 1, 32, 23)
B1 = fi(-256, 1, 32, 23)
BW = 6283.185
NF_s = tf(num={[1 0 394784.2]}, den={[1 6283.185 394784.2]}, Ts=0)
NF_z = tf(num={[1 -1.999849 0.9999969]}, den={[1 -1.881763 0.8819114]}, Ts=2.0e-5)
NF_z2 = tf(num={[1 -1.989188 0.9981664]}, den={[1 -1.275631 0.2846095]}, Ts=0.0002)
NFout = fi([0; 0; -0.06670898; -0.04910559; -0.05146451; -0.05018542; -0.04814969; -0.0471085; -0.04568533; -0.04424163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 0.004903829], 1, 32, 31)
PDout = fi([0; 0; -0.06670898; -0.1329346; -0.1970014; -0.2591746; -0.3168742; -0.3699745; -0.4174672; -0.4584365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 -0.05810546875], 1, 32, 31)
PIout = fi([0; 0; -17.0775; -12.57103; -13.17492; -12.84747; -12.32632; -12.05978; -11.69545; -11.32586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 1.255388], 1, 32, 24)
cos_th = fi([0; 0.99; 0.99; 0.986452; 0.9793164; 0.9685947; 0.9542918; 0.9364435; 0.9150857; 0.8902709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 1], 1, 32, 31)
h_g_s = tf(num={[350 200000]}, den={[1 0]}, Ts=0)
h_g_z = tf(num={[352 -348]}, den={[1 -1]}, Ts=2.0e-5)
h_g_z2 = tf(num={[370 -330]}, den={[1 -1]}, Ts=0.0002)
k = 1751
kii = 200000
kpp = 350
phase_th = fi([0; 0; 0.05941635; 0.119734; 0.1799309; 0.2401932; 0.3005598; 0.3609797; 0.4214725; 0.4820392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 -0.04493448], 1, 32, 29)
pi32 = fi(3.141593, 1, 32, 29)
q = 0.1
sin_in = fi([0 -0.0673828125 -0.13427734375 -0.19970703125 -0.2646484375 -0.3271484375 -0.3876953125 -0.44580078125 -0.5009765625 -0.5537109375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 0], 1, 12, 11)
sin_th = fi([0; 0; 0.05882219; 0.1185367; 0.177918; 0.2369339; 0.2954047; 0.3530629; 0.4097109; 0.4651346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 -0.01868482], 1, 32, 31)
t = [0 0.0002 0.0004 0.0006 0.0008 0.001 0.0012 0.0014 0.0016 0.0018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 0.35]
tsample = 0.0002
tsim = 0.35
wo = 628.3185
wout = fi(words=uint32([996812480; 1]), 1, 35, 24)
ws = fi(314.1593, 1, 32, 22)
Configuration = Simulink.ConfigSet(StartTime="0", StopTime="3/5", FixedStep="tsample", Solver="FixedStepDiscrete", ProdHWDeviceType="Intel->x86-64 (Windows64)", SystemTargetFile="ert.tlc", TargetLang="C")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
QuickStart_50024_6_23_9_31_16537 = Simulink.ConfigSet(StartTime="0", StopTime="3/5", FixedStep="tsample", Solver="FixedStepDiscrete", ProdHWDeviceType="AMD->Athlon 64", SystemTargetFile="ert.tlc", TargetLang="C")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