test file "sil_test_signal_lock_freq"
  description: Automatically generated test file for SIL/PIL verification

suite "SIL/PIL Test Suite"
  description: Automatically generated test suite for SIL/PIL verification

  case "SIL/PIL Equivalence Test" [equivalence]
    description: Equivalence test to check generated code for srf_pll_Harness1
    simulation 1:
      model pd_nf_pi_dvco
    simulation 2:
      model pd_nf_pi_dvco

  case "SIL/PIL Equivalence Test 1" [equivalence]
    description: Equivalence test to check generated code for srf_pll_Harness1
    simulation 1:
      model pd_nf_pi_dvco
    simulation 2:
      model pd_nf_pi_dvco