test file "srf_pll_Harness2_TestFile"
  description: Automatically generated test file for SIL/PIL verification

suite "SIL/PIL Test Suite"
  description: Automatically generated test suite for SIL/PIL verification

  case "SIL/PIL Equivalence Test" [equivalence]
    description: Equivalence test to check generated code for srf_pll_Harness2
    simulation 1:
      model fault_detection
    simulation 2:
      model fault_detection