test file "test_files_srf_pll"

suite "New Test Suite 1"

  case "Track_Freq" [baseline]
    model srf_pll, harness srf_pll_Harness1 (for srf_pll/Model)
    assessment "Assessment1": At any point of time, whenever trigger is true then, with no delay, abs(freq_in-freq_out)<20 must be true
      trigger: signal srf_pll_Harness1/Chart, port 2
      freq_in: signal srf_pll_Harness1/Constant, port 1
      freq_out: signal srf_pll_Harness1/Model, port 3

  case "Lock_to_Signal" [simulation]
    model srf_pll, harness srf_pll_Harness1 (for srf_pll/Model)
    assessment "Assessment1": At any point of time, if trigger2 becomes true then, with no delay, abs(sin_in-sin_out)<0.2 must be true
      trigger2: signal srf_pll_Harness1/Chart, port 2
      sin_in: signal srf_pll_Harness1/Sine Wave, port 1
      sin_out: signal srf_pll_Harness1/Model, port 2

  case "Fault_voltage_drop" [simulation]
    model srf_pll, harness srf_pll_Harness2 (for srf_pll/Model2)
    assessment "Assessment1": At any point of time, if trigger2 becomes true then, with a delay of at most 0.1, vdip must stay true for at least 0.005
      trigger2: signal srf_pll_Harness2/Chart, port 2
      vdip: signal srf_pll_Harness2/Demux, port 1

  case "Fault_freq_oob" [simulation]
    model srf_pll, harness srf_pll_Harness2 (for srf_pll/Model2)
    assessment "Assessment2": At any point of time, whenever (freq==650) is true then, with no delay, (freqoob) must be true
      freq: signal srf_pll_Harness2/Step1, port 1
      freqoob: signal srf_pll_Harness2/Demux, port 2